# Grasshopper definition flockingTest.gh (Grasshopper 0.9.75)
# plug-ins: Agent

number_slider = Slider(15, range=0..100)
number_slider_2 = Slider(2, range=0..10)
planesrf = PlaneSurface(Plane=PlaneXY(0, 0, 0), XSize=Domain(-10, 10), YSize=Domain(-10, 10))  # disabled
number_slider_3 = Slider(4, range=0..10)
wires = BrepWireframe(Brep=planesrf, Density=-1)
box = CenterBox(Base=PlaneXY(0, 0, 0), X=number_slider, Y=number_slider, Z=number_slider)
wires_2 = BrepWireframe(Brep=box, Density=-1)
particle = ConstructParticle(
    MinimumInitialVelocity=Vector(-0.1, -0.1, -0.1),
    MaximumInitialVelocity=Vector(0.1, 0.1, 0.1),
    Acceleration=Vector(0, 0, 0),
    Lifespan=Slider(289, range=-1..1000),
    Mass=1,
    BodySize=1,
    HistoryLength=1)
aaboxenv = AxisAlignedBoxEnvironment(Box=box)
join = JoinCurves(Curves=wires, Preserve=False)
agent = ConstructAgent(Particle=particle, MaxSpeed=0.5, MaxForce=0.1, VisionRadius=5, VisionAngle=360)
boxemit = BoxEmitter(ContinuousFlow=True, CreationRate=1, NumberOfQuelea=0, Box=box)
srfenv = SurfaceEnvironment(Surface=planesrf)  # -> Environment, _2DReferenceSurface; disabled
system = System(Quelea=agent, Emitters=boxemit, Environment=aaboxenv)  # -> System, Quelea, QueleaNetwork
followpath = FollowPathForce(
    Apply=True,
    WeightMultiplier=1,
    Agent=system.Quelea,
    Curve=join,
    PathRadius=Slider(1.5, range=0..10),
    PredictionDistance=number_slider_3,
    PathTargetDistance=number_slider_3)  # -> Force, DesiredVelocity, PredictionLocation, PathPoint
timer = Timer(TimerInterval=20, Target=[engine, system])  # disabled
contain = ContainForce(Apply=True, WeightMultiplier=1, Agent=system.Quelea, Environment=aaboxenv, VisionRadiusMutliplier=0.2)  # -> Force, DesiredVelocity
engine = Engine(Reset=Toggle(True), System=system.System)
neighbors = GetNeighborsInRadius(Agent=system.Quelea, QueleaNetwork=system.QueleaNetwork, VisionRadiusMultiplier=1, VisionAngleMultiplier=1)
neighbors_2 = GetNeighborsInRadius(Agent=system.Quelea, QueleaNetwork=neighbors, VisionRadiusMultiplier=Slider(0.333, range=0..1), VisionAngleMultiplier=1)
departicle = DeconstructParticle(Particle=system.Quelea)  # -> Position, Velocity, Acceleration, Lifespan, SurfacePosition, SurfaceVelocity, SurfaceAcceleration
item = ListItem(List=departicle.Position, Index=0, Wrap=True)  # -> flatten(Item)
pt = Point(departicle.Position)
pt_2 = Point(departicle.SurfacePosition)
cohese = CoheseForce(Apply=True, WeightMultiplier=1, Agent=system.Quelea, GetNeighborsInRadius=neighbors)  # -> Force, DesiredVelocity
separate = SeparateForce(Apply=True, WeightMultiplier=Slider(1, range=0..1), Agent=system.Quelea, GetNeighborsInRadius=neighbors_2)  # -> Force, DesiredVelocity
vdis = VectorDisplay(Anchor=item, Vector=departicle.Velocity)
vdis_2 = VectorDisplay(Anchor=pt_2)
vdis_3 = VectorDisplay(Anchor=pt_2)  # disabled
